# Grasshopper definition R1.gh (Grasshopper 1.0.7)

number_slider = Slider(9, range=0..10)
number = Slider(6, range=0..10)
xz = XZPlane(Origin=Point(0, 0, 0))
range = Range(Domain="360", Steps=number_slider)
cir = Circle(Plane=xz, Radius=Slider(10, range=0..10))
cull_i = CullIndex(List=range, Indices="-1", Wrap=True)
checkbox = Slider(5, range=0..10)
range_2 = Slider(4, range=0..10)
pframes = PerpFrames(Curve=cir, Count=number_slider, Align=True)  # -> Frames, Parameters
rad = Radians(Degrees=cull_i)
multiplication = Multiplication(A=rad, B=number)
rotate = Rotate(Geometry=pframes.Frames, Angle=multiplication, Plane=pframes.Frames)  # -> Geometry, Transform
polygon = Polygon(Plane=rotate.Geometry, Radius=checkbox, Segments=range_2, FilletRadius=Slider(0.9, range=0..1))  # -> Polygon, Length
pt = Point(<point referenced from the Rhino model>)
area = Area(Geometry=polygon.Polygon)  # -> Area, Centroid
pull = PullPoint(Point=area.Centroid, Geometry=pt, ClosestOnly=True)  # -> ClosestPoint, Distance
dom = ConstructDomain(DomainStart=Slider(1, range=0..1), DomainEnd=Slider(0.2, range=0..1))
bnd = Bounds(Numbers=pull.Distance)
remap = RemapNumbers(Value=pull.Distance, Source=bnd, Target=dom)  # -> Mapped, Clipped
scale = Scale(Geometry=polygon.Polygon, Center=area.Centroid, Factor=remap.Mapped)  # -> Geometry, Transform
loft_opt = LoftOptions(Closed=Toggle(True), Adjust=Toggle(False), Rebuild=Toggle(False), Refit=Toggle(False), Type=Toggle(True))
loft = Loft(Curves=scale.Geometry, Options=loft_opt)
preview = CustomPreview(
    Geometry=loft,
    Material={diffuse=RGB(221, 160, 221), emission=RGB(66, 48, 66), shine=0.5, specular=RGB(255, 255, 255), transparency=0})
